# Grasshopper definition Transforming Text.gh (Grasshopper 1.0.7)
# plug-ins: Bifocals

# ---- group: 3D Grid Text / Grid Parameters
y_distance = Slider(13.181, range=0..20)  # disabled
y_number = Slider(4, range=0..10)  # disabled
z_distance = Slider(8.179, range=0..20)  # disabled
z_number = Slider(4, range=0..10)  # disabled
x_distance = Slider(16.619, range=0..20)  # disabled
x_number = Slider(4, range=0..10)  # disabled

# ---- group: Repeating text 1D / Inputs
number_slider = Slider(10, range=0..10)  # disabled
number_slider_2 = Slider(5, range=0..50)  # disabled
number_slider_3 = Slider(0, range=0..10)  # disabled
brep = Brep([<brep referenced from the Rhino model> x11])  # disabled

# ---- group: Text along Surface / Suface Orienting On
number_slider_4 = Slider(4, range=0..15)  # disabled
number_slider_5 = Slider(15, range=0..15)  # disabled
surface = Surface(<surface referenced from the Rhino model>)  # disabled
surface_frames = SurfaceFrames(Surface=surface, UCount=number_slider_4, VCount=number_slider_5)  # -> graft(Frames), Parameters; disabled

# ---- group: Repeating text 1D
series = Series(Start=number_slider_3, Step=number_slider, Count=number_slider_2)  # -> graft(Series); disabled
panel = Panel(series)  # disabled
vector_xyz = VectorXYZ(XComponent=0, YComponent=0, ZComponent=series)  # -> Vector, Length; disabled
move = Move(Geometry=brep, Motion=vector_xyz.Vector)  # -> Geometry, Transform; disabled
panel_2 = Panel(vector_xyz.Vector)  # disabled

# ---- group: Object Parameters
brep_2 = Brep([<brep referenced from the Rhino model> x7])  # disabled
number_slider_6 = Slider(0.2886, range=0..10)  # disabled

# ---- group: 3D Grid Text
point = Point(<point referenced from the Rhino model>)  # disabled
series_2 = Series(Start=0, Step=x_distance, Count=x_number)  # disabled
series_3 = Series(Start=0, Step=y_distance, Count=y_number)  # disabled
vector_xyz_2 = VectorXYZ(XComponent=series_2, YComponent=0, ZComponent=0)  # -> Vector, Length; disabled
series_4 = Series(Start=0, Step=z_distance, Count=z_number)  # disabled
vector_xyz_3 = VectorXYZ(XComponent=0, YComponent=series_3, ZComponent=0)  # -> Vector, Length; disabled
move_2 = Move(Geometry=point, Motion=vector_xyz_2.Vector)  # -> Geometry, Transform; disabled
vector_xyz_4 = VectorXYZ(XComponent=0, YComponent=0, ZComponent=series_4)  # -> Vector, Length; disabled
graft_tree = GraftTree(Tree=move_2.Geometry, IncludeEmptyLists=True, IncludeNullItems=True)  # disabled
move_3 = Move(Geometry=graft_tree, Motion=vector_xyz_3.Vector)  # -> Geometry, Transform; disabled
panel_3 = Panel(graft_tree)  # disabled
graft_tree_2 = GraftTree(Tree=move_3.Geometry, IncludeEmptyLists=True, IncludeNullItems=True)  # disabled
move_4 = Move(Geometry=graft_tree_2, Motion=vector_xyz_4.Vector)  # -> graft(Geometry), Transform; disabled
scale_nu = ScaleNU(Geometry=brep_2, Plane=point, ScaleX=number_slider_6, ScaleY=number_slider_6, ScaleZ=number_slider_6)  # -> Geometry, Transform; disabled
panel_4 = Panel(move_4.Geometry)  # disabled
orient = Orient(Geometry=scale_nu.Geometry, Source=point, Target=move_4.Geometry)  # -> Geometry, Transform; disabled
panel_5 = Panel(scale_nu.Geometry)  # disabled

# ---- group: Colouring
y = Slider(10, range=0..100)  # disabled
z = Slider(42, range=0..100)  # disabled
y_2 = Slider(5, range=0..100)  # disabled
z_2 = Slider(23, range=0..100)  # disabled
x_cord = Slider(80, range=0..100)  # disabled
x_cord_2 = Slider(77, range=0..100)  # disabled
x_cord_3 = Slider(78, range=0..100)  # disabled
y_3 = Slider(5, range=0..100)  # disabled
z_3 = Slider(5, range=0..100)  # disabled
brep_3 = Brep([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])  # disabled
mesh_brep = MeshBrep(
    Brep=brep_3,
    Settings={GridMaxCount=0, GridMinCount=16, JaggedSeams=False, MaxEdgeLength=0, MinEdgeLength=0.0001, MinTolerance=0, Refine=True, RefineAngle=0, RelativeTolerance=0.65, SimplePlanes=True, Tolerance=0})  # disabled
construct_point = ConstructPoint(XCoordinate=x_cord, YCoordinate=y, ZCoordinate=z)  # disabled
construct_point_2 = ConstructPoint(XCoordinate=x_cord_2, YCoordinate=y_2, ZCoordinate=z_2)  # disabled
construct_point_3 = ConstructPoint(XCoordinate=x_cord_3, YCoordinate=y_3, ZCoordinate=z_3)  # disabled
colour_swatch = ColourSwatch(SwatchColor=RGB(13, 30, 255))  # disabled
colour_swatch_2 = ColourSwatch(SwatchColor=RGB(255, 255, 255))  # disabled
colour_swatch_3 = ColourSwatch(SwatchColor=RGB(13, 30, 255))  # disabled
mesh_spray = MeshSpray(Mesh=mesh_brep, Points=[construct_point_3, construct_point], Colours=[colour_swatch_2, colour_swatch], SprayMode=11)  # disabled

# ---- group: Text on Sphere / Sphere Parameters
y_4 = Slider(49.87, range=0..100)  # disabled
x = Slider(30, range=0..100)  # disabled
z_4 = Slider(22.06, range=0..100)  # disabled
radius = Slider(19.7, range=0..100)  # disabled

# ---- group: Text on Sphere / Object Parameters
brep_4 = Brep([<brep referenced from the Rhino model> x11])  # disabled
point_2 = Point(<point referenced from the Rhino model>)  # disabled
number_slider_7 = Slider(0.15, range=0..10)  # disabled
xy_plane = XYPlane(Origin=point_2)  # disabled
scale_nu_2 = ScaleNU(Geometry=brep_4, Plane=xy_plane, ScaleX=number_slider_7, ScaleY=number_slider_7, ScaleZ=number_slider_7)  # -> Geometry, Transform; disabled

# ---- group: Text on Sphere / U V Count
u_count = Slider(15, range=0..20)  # disabled
v_count = Slider(15, range=0..20)  # disabled

# ---- group: Text on Sphere
construct_point_4 = ConstructPoint(XCoordinate=x, YCoordinate=y_4, ZCoordinate=z_4)  # disabled
sphere = Sphere(Base=construct_point_4, Radius=radius)  # disabled
surface_frames_2 = SurfaceFrames(Surface=sphere, UCount=u_count, VCount=v_count)  # -> graft(Frames), Parameters; disabled
orient_2 = Orient(Geometry=scale_nu_2.Geometry, Source=point_2, Target=surface_frames_2.Frames)  # -> Geometry, Transform; disabled

# ---- group: Text along Surface / Scale Text
point_3 = Point(<point referenced from the Rhino model>)  # disabled
number_slider_8 = Slider(0.15, range=0..10)  # disabled
xy_plane_2 = XYPlane(Origin=point_3)  # disabled

# ---- group: Text along Surface
brep_5 = Brep([<brep referenced from the Rhino model> x11])  # disabled
panel_6 = Panel(brep_5)  # disabled

# ---- group: Text along Surface / Scale Text (continued)
scale_nu_3 = ScaleNU(Geometry=brep_5, Plane=xy_plane_2, ScaleX=number_slider_8, ScaleY=number_slider_8, ScaleZ=number_slider_8)  # -> Geometry, Transform; disabled

# ---- group: Text along Surface (continued)
panel_7 = Panel(scale_nu_3.Geometry)  # disabled
orient_3 = Orient(Geometry=scale_nu_3.Geometry, Source=xy_plane_2, Target=surface_frames.Frames)  # -> Geometry, Transform; disabled
transform_matrix = TransformMatrix(orient_3.Transform, Digits=3)  # disabled
panel_8 = Panel(orient_3.Geometry)  # disabled
