# Grasshopper definition Trinagulating a surface.gh (Grasshopper 1.0.7)
# plug-ins: Bifocals

distance_between_panels = Slider(6.38, range=0..25)  # disabled
distance_between_panels_2 = Slider(11.22, range=0..25)  # disabled
point_for_x_panels = Point(<point referenced from the Rhino model>)  # disabled
point_for_y_panels = Point(<point referenced from the Rhino model>)  # disabled

u = Slider(8, range=0..10)  # disabled
v = Slider(8, range=0..10)  # disabled
surface = Surface(<surface referenced from the Rhino model>)  # disabled

divide_surface = DivideSurface(Surface=surface, UCount=u, VCount=v)  # -> Points, Normals, Parameters; disabled

# ---- group: List manipualtions
tree_statistics = TreeStatistics(Tree=divide_surface.Points)  # -> Paths, Length, Count; disabled
panel = Panel("False")  # disabled
panel_2 = Panel("1")  # disabled
shift_list = ShiftList(List=tree_statistics.Paths, Shift=panel_2, Wrap=panel)  # disabled
tree_branch = TreeBranch(Tree=divide_surface.Points, Path=shift_list, MaintainPaths=True)  # disabled
panel_3 = Panel("False")  # disabled
panel_4 = Panel("-1")  # disabled
shift_list_2 = ShiftList(List=tree_branch, Shift=panel_4, Wrap=panel_3)  # disabled

tree_statistics_2 = TreeStatistics(Tree=divide_surface.Points)  # -> Paths, Length, Count; disabled
panel_5 = Panel("False")  # disabled
panel_6 = Panel("-1")  # disabled
shift_list_3 = ShiftList(List=tree_statistics_2.Paths, Shift=panel_6, Wrap=panel_5)  # disabled
tree_branch_2 = TreeBranch(Tree=divide_surface.Points, Path=shift_list_3, MaintainPaths=True)  # disabled
panel_7 = Panel("False")  # disabled
panel_8 = Panel("-1")  # disabled
shift_list_4 = ShiftList(List=tree_branch_2, Shift=panel_8, Wrap=panel_7)  # disabled

tree_statistics_3 = TreeStatistics(Tree=divide_surface.Points)  # -> Paths, Length, Count; disabled
panel_9 = Panel("False")  # disabled
panel_10 = Panel("-1")  # disabled
shift_list_5 = ShiftList(List=tree_statistics_3.Paths, Shift=panel_10, Wrap=panel_9)  # disabled
tree_branch_3 = TreeBranch(Tree=divide_surface.Points, Path=shift_list_5, MaintainPaths=True)  # disabled
panel_11 = Panel("False")  # disabled
panel_12 = Panel("1")  # disabled
shift_list_6 = ShiftList(List=tree_branch_3, Shift=panel_12, Wrap=panel_11)  # disabled

tree_statistics_4 = TreeStatistics(Tree=divide_surface.Points)  # -> Paths, Length, Count; disabled
panel_13 = Panel("False")  # disabled
panel_14 = Panel("1")  # disabled
shift_list_7 = ShiftList(List=tree_statistics_4.Paths, Shift=panel_14, Wrap=panel_13)  # disabled
tree_branch_4 = TreeBranch(Tree=divide_surface.Points, Path=shift_list_7, MaintainPaths=True)  # disabled
panel_15 = Panel("False")  # disabled
panel_16 = Panel("1")  # disabled
shift_list_8 = ShiftList(List=tree_branch_4, Shift=panel_16, Wrap=panel_15)  # disabled

# ----
bottom_right_points = Point(shift_list_6)  # disabled
bottom_left_points = Point(shift_list_4)  # disabled
top_right_points = Point(shift_list_8)  # disabled
top_left_points = Point(shift_list_2)  # disabled

# ---- group: Triangle Surfaces
_4point_surface = _4PointSurface(CornerA=bottom_left_points, CornerB=bottom_right_points, CornerC=top_left_points)  # disabled
_4point_surface_2 = _4PointSurface(CornerA=bottom_right_points, CornerB=top_right_points, CornerC=top_left_points)  # disabled
final_surface = Surface([_4point_surface_2, _4point_surface])  # disabled

# ---- group: Flattening Surface
plane_3pt = Plane3Pt(PointA=bottom_left_points, PointB=bottom_right_points, PointC=top_left_points)  # disabled
series = Series(Start=0, Step=distance_between_panels, Count=v)  # disabled
series_2 = Series(Start=0, Step=distance_between_panels_2, Count=u)  # disabled
unit_y = UnitY(Factor=series_2)  # disabled
unit_x = UnitX(Factor=series)  # disabled
xy_plane = XYPlane(Origin=point_for_x_panels)  # disabled
move = Move(Geometry=xy_plane, Motion=unit_x)  # -> Geometry, Transform; disabled
graft_tree = GraftTree(Tree=move.Geometry, IncludeEmptyLists=True, IncludeNullItems=True)  # disabled
move_2 = Move(Geometry=graft_tree, Motion=unit_y)  # -> Geometry, Transform; disabled
flip_matrix = FlipMatrix(Data=move_2.Geometry)  # disabled
orient = Orient(Geometry=_4point_surface, Source=plane_3pt, Target=flip_matrix)  # -> Geometry, Transform; disabled

plane_3pt_2 = Plane3Pt(PointA=top_right_points, PointB=top_left_points, PointC=bottom_right_points)  # disabled
series_3 = Series(Start=0, Step=distance_between_panels, Count=v)  # disabled
series_4 = Series(Start=0, Step=distance_between_panels_2, Count=u)  # disabled
unit_y_2 = UnitY(Factor=series_4)  # disabled
unit_x_2 = UnitX(Factor=series_3)  # disabled
xy_plane_2 = XYPlane(Origin=point_for_y_panels)  # disabled
move_3 = Move(Geometry=xy_plane_2, Motion=unit_x_2)  # -> Geometry, Transform; disabled
graft_tree_2 = GraftTree(Tree=move_3.Geometry, IncludeEmptyLists=True, IncludeNullItems=True)  # disabled
move_4 = Move(Geometry=graft_tree_2, Motion=unit_y_2)  # -> Geometry, Transform; disabled
flip_matrix_2 = FlipMatrix(Data=move_4.Geometry)  # disabled
orient_2 = Orient(Geometry=_4point_surface_2, Source=plane_3pt_2, Target=flip_matrix_2)  # -> Geometry, Transform; disabled

# ----
surface_2 = Surface(orient.Geometry)  # disabled

surface_3 = Surface(orient_2.Geometry)  # disabled

# ---- group: FInal Surface Flatenned
final_surface_flatenned = Surface([surface_3, surface_2])  # disabled
