# Grasshopper definition Trusses.gh (Grasshopper 1.0.7)
# plug-ins: Bifocals

# ---- group: Pratt Truss / Params
supports = Slider(10, range=0..16)  # disabled
height_depth = Slider(10, range=0..10)  # disabled

# ---- group: Vierendeel Truss / Params
supports_2 = Slider(9, range=0..15)  # disabled
height_depth_2 = Slider(6.28, range=0..10)  # disabled

# ---- group: Warren Spatial Truss / Arch Params
spans = Slider(17, range=0..100)  # disabled
void = Slider(3, range=0..10)  # disabled
height = Slider(3, range=0..20)  # disabled
depth = Slider(8, range=0..20)  # disabled
width = Slider(6, range=0..20)  # disabled

# ---- group: Pratt Truss
point = Point(<point referenced from the Rhino model>)  # disabled
point_2 = Point(<point referenced from the Rhino model>)  # disabled

# ---- group: Vierendeel Truss
point_3 = Point(<point referenced from the Rhino model>)  # disabled
point_4 = Point(<point referenced from the Rhino model>)  # disabled

# ---- group: Warren Spatial Truss
point_5 = Point(<point referenced from the Rhino model>)  # disabled
point_6 = Point(<point referenced from the Rhino model>)  # disabled

# ---- group: Pratt Truss
line = Line(StartPoint=point_2, EndPoint=point)  # disabled
length = Length(Curve=line)  # disabled
divide_curve = DivideCurve(Curve=line, Count=supports, Kinks=False)  # -> Points, Tangents, Parameters; disabled
expression = Expression(L=length, Factor=height_depth, Expression="- L / factor")  # disabled
expression_2 = Expression(x=supports, Expression="x-1")  # disabled
panel = Panel("1")  # disabled
unit_z = UnitZ(Factor=expression)  # disabled
construct_domain = ConstructDomain(DomainStart=panel, DomainEnd=expression_2)  # disabled
sub_list = SubList(List=divide_curve.Points, Domain=construct_domain, Wrap=True)  # -> List, Index; disabled
move = Move(Geometry=sub_list.List, Motion=unit_z)  # -> Geometry, Transform; disabled

# ---- group: Vierendeel Truss
line_2 = Line(StartPoint=point_4, EndPoint=point_3)  # disabled
length_2 = Length(Curve=line_2)  # disabled
divide_curve_2 = DivideCurve(Curve=line_2, Count=supports_2, Kinks=False)  # -> Points, Tangents, Parameters; disabled
expression_3 = Expression(L=length_2, Factor=height_depth_2, Expression="- L / factor")  # disabled
unit_z_2 = UnitZ(Factor=expression_3)  # disabled
move_2 = Move(Geometry=divide_curve_2.Points, Motion=unit_z_2)  # -> Geometry, Transform; disabled
bottom_node = Point(move_2.Geometry)  # disabled
top_node = Point(divide_curve_2.Points)  # disabled
vertical_bars = Line(StartPoint=top_node, EndPoint=bottom_node)  # disabled

# ---- group: Warren Spatial Truss
distance = Distance(PointA=point_6, PointB=point_5)  # disabled
division = Division(A=distance, B=height)  # disabled
division_2 = Division(A=distance, B=depth)  # disabled
division_3 = Division(A=distance, B=width)  # disabled
height_2 = Number(division)  # disabled
depth_2 = Number(division_2)  # disabled
width_2 = Number(division_3)  # disabled

# ---- group: Pratt Truss / source nodes
top_nodes_w_o_first_last = Point(sub_list.List)  # disabled
top_nodes_all = Point(divide_curve.Points)  # disabled
bottom_nodes = Point(move.Geometry)  # disabled

# ---- group: Vierendeel Truss / Top Bar
# Taking out the last item on the list
# Taking out the first item on the list
panel_2 = Panel("1")  # disabled
split_list = SplitList(List=top_node, Index=supports_2)  # -> ListA, ListB; disabled
split_list_2 = SplitList(List=top_node, Index=panel_2)  # -> ListA, ListB; disabled
line_3 = Line(StartPoint=split_list.ListA, EndPoint=split_list_2.ListB)  # disabled

# ---- group: Vierendeel Truss / Bottom Bar
panel_3 = Panel("1")  # disabled
split_list_3 = SplitList(List=bottom_node, Index=supports_2)  # -> ListA, ListB; disabled
split_list_4 = SplitList(List=bottom_node, Index=panel_3)  # -> ListA, ListB; disabled
line_4 = Line(StartPoint=split_list_3.ListA, EndPoint=split_list_4.ListB)  # disabled

# ---- group: Pratt Truss / Right
expression_4 = Expression(N=supports, Expression="(N - 2) / 2")  # disabled
expression_5 = Expression(N=supports, Expression="N - 2")  # disabled
expression_6 = Expression(N=supports, Expression="(N / 2) + 1")  # disabled
construct_domain_2 = ConstructDomain(DomainStart=expression_4, DomainEnd=expression_5)  # disabled
construct_domain_3 = ConstructDomain(DomainStart=expression_6, DomainEnd=supports)  # disabled
sub_list_2 = SubList(List=top_nodes_all, Domain=construct_domain_3, Wrap=True)  # -> List, Index; disabled
sub_list_3 = SubList(List=bottom_nodes, Domain=construct_domain_2, Wrap=True)  # -> List, Index; disabled
line_5 = Line(StartPoint=sub_list_2.List, EndPoint=sub_list_3.List)  # disabled

# ---- group: Pratt Truss / Diagonals Left
expression_7 = Expression(N=supports, Expression="(N/2) -1")  # disabled
panel_4 = Panel("0")  # disabled
construct_domain_4 = ConstructDomain(DomainStart=panel_4, DomainEnd=expression_7)  # disabled
sub_list_4 = SubList(List=top_nodes_all, Domain=construct_domain_4, Wrap=True)  # -> List, Index; disabled
sub_list_5 = SubList(List=bottom_nodes, Domain=construct_domain_4, Wrap=True)  # -> List, Index; disabled
line_6 = Line(StartPoint=sub_list_4.List, EndPoint=sub_list_5.List)  # disabled
left_diagonals = Line(line_6)  # disabled

# ---- group: Pratt Truss / Bottom Bars
panel_5 = Panel("-1")  # disabled
panel_6 = Panel("False")  # disabled
panel_7 = Panel("1")  # disabled
panel_8 = Panel("False")  # disabled
shift_list = ShiftList(List=bottom_nodes, Shift=panel_5, Wrap=panel_6)  # disabled
shift_list_2 = ShiftList(List=bottom_nodes, Shift=panel_7, Wrap=panel_8)  # disabled
line_7 = Line(StartPoint=shift_list, EndPoint=shift_list_2)  # disabled
bottom_bars = Line(line_7)  # disabled

# ---- group: Pratt Truss / Top Bars
panel_9 = Panel("False")  # disabled
panel_10 = Panel("1")  # disabled
panel_11 = Panel("-1")  # disabled
panel_12 = Panel("False")  # disabled
shift_list_3 = ShiftList(List=top_nodes_all, Shift=panel_11, Wrap=panel_9)  # disabled
shift_list_4 = ShiftList(List=top_nodes_all, Shift=panel_10, Wrap=panel_12)  # disabled
top_bars = Line(StartPoint=shift_list_3, EndPoint=shift_list_4)  # disabled
top_bars_2 = Line(top_bars)  # disabled

# ---- group: Vierendeel Truss / Final Structure
vierendeel_truss = Line([line_3, line_4, vertical_bars])  # disabled

# ---- group: Pratt Truss / Vertical Bars
vertical_bars_2 = Line(StartPoint=top_nodes_w_o_first_last, EndPoint=bottom_nodes)  # disabled
vertical_bars_3 = Line(vertical_bars_2)  # disabled

# ---- group: Vierendeel Truss / Visualization
number_slider = Slider(0.53, range=0..10)  # disabled
number_slider_2 = Slider(2, range=0..2)  # disabled
pipe = Pipe(Curve=vierendeel_truss, Radius=number_slider, Caps=number_slider_2)  # disabled

# ---- group: Pratt Truss / Right / Right Diagonals
right_diagonals = Line(line_5)  # disabled

# ---- group: Pratt Truss / Final Structure
pratt_truss = Line([bottom_bars, top_bars_2, vertical_bars_3, left_diagonals, right_diagonals])  # disabled

# ---- group: Visualization
number_slider_3 = Slider(0.28, range=0..10)  # disabled
number_slider_4 = Slider(2, range=0..2)  # disabled
pipe_2 = Pipe(Curve=pratt_truss, Radius=number_slider_3, Caps=number_slider_4)  # disabled

# ---- group: Around Curve to make Structure
# plug in any two parallel curves
# to see structure built
number_slider_5 = Slider(8, range=0..20)  # disabled
curve = Curve(<curve referenced from the Rhino model>)  # disabled
curve_2 = Curve(<curve referenced from the Rhino model>)  # disabled
divide_curve_3 = DivideCurve(Curve=curve, Count=number_slider_5, Kinks=False)  # -> graft(Points), Tangents, Parameters; disabled
divide_curve_4 = DivideCurve(Curve=curve_2, Count=number_slider_5, Kinks=False)  # -> graft(Points), Tangents, Parameters; disabled

# ---- group: Warren Spatial Truss
line_8 = Line(StartPoint=point_6, EndPoint=point_5)  # disabled
panel_13 = Panel("0.5")  # disabled
evaluate_curve = EvaluateCurve(Curve=line_8, Parameter=panel_13)  # -> Point, Tangent, Angle; disabled
unit_z_3 = UnitZ(Factor=height_2)  # disabled
unit_z_4 = UnitZ(Factor=depth_2)  # disabled
move_3 = Move(Geometry=evaluate_curve.Point, Motion=unit_z_3)  # -> Geometry, Transform; disabled
plane_3pt = Plane3Pt(PointA=point_6, PointB=point_5, PointC=move_3.Geometry)  # disabled
interpolate = Interpolate(Vertices=[point_5, move_3.Geometry, point_6], Degree=3, Periodic=False, KnotStyle=1)  # -> Curve, Length, Domain; disabled

# ---- group: Around Curve to make Structure (continued)
flatten_tree = FlattenTree(Tree=interpolate.Curve, Path="{0}")  # disabled
loft = Loft(Curves=flatten_tree, Options={Adjust=False, Closed=False, LoftEnds=0, LoftSimp=0, LoftType=0, Rebuild=10, Refit=0.01})  # disabled

# ---- group: Warren Spatial Truss / Maths for top arches
deconstruct_plane = DeconstructPlane(Plane=plane_3pt)  # -> Origin, XAxis, YAxis, ZAxis; disabled
expression_8 = Expression(w=width_2, Expression="-w/2")  # disabled
expression_9 = Expression(w=width_2, Expression="w/2")  # disabled
multiplication = Multiplication(A=deconstruct_plane.ZAxis, B=expression_9)  # disabled
multiplication_2 = Multiplication(A=deconstruct_plane.ZAxis, B=expression_8)  # disabled
addition = Addition(A=unit_z_4, B=multiplication)  # disabled
addition_2 = Addition(A=unit_z_4, B=multiplication_2)  # disabled
vector_display = VectorDisplay(Vector=[addition_2, addition])  # disabled

# ---- group: Warren Spatial Truss (continued)
move_4 = Move(Geometry=move_3.Geometry, Motion=addition)  # -> Geometry, Transform; disabled
move_5 = Move(Geometry=move_3.Geometry, Motion=addition_2)  # -> Geometry, Transform; disabled
interpolate_2 = Interpolate(Vertices=[point_5, move_4.Geometry, point_6], Degree=3, Periodic=False, KnotStyle=1)  # -> Curve, Length, Domain; disabled
interpolate_3 = Interpolate(Vertices=[point_5, move_5.Geometry, point_6], Degree=3, Periodic=False, KnotStyle=1)  # -> Curve, Length, Domain; disabled

# ---- group: Warren Spatial Truss / arch geomrtries
top_right_arch = Curve(interpolate_3.Curve)  # disabled
top_left_arch = Curve(interpolate_2.Curve)  # disabled
base_arch = Curve(interpolate.Curve)  # disabled

# ---- group: Warren Spatial Truss (continued)
divide_curve_5 = DivideCurve(Curve=base_arch, Count=spans, Kinks=False)  # -> Points, Tangents, Parameters; disabled
divide_curve_6 = DivideCurve(Curve=top_left_arch, Count=spans, Kinks=False)  # -> Points, Tangents, Parameters; disabled
divide_curve_7 = DivideCurve(Curve=top_right_arch, Count=spans, Kinks=False)  # -> Points, Tangents, Parameters; disabled

# ---- group: Warren Spatial Truss / List Data Manipulation
subtraction = Subtraction(A=spans, B=void)  # disabled
construct_domain_5 = ConstructDomain(DomainStart=void, DomainEnd=subtraction)  # disabled
sub_list_6 = SubList(List=divide_curve_5.Points, Domain=construct_domain_5, Wrap=True)  # -> List, Index; disabled
sub_list_7 = SubList(List=divide_curve_6.Points, Domain=construct_domain_5, Wrap=True)  # -> List, Index; disabled
sub_list_8 = SubList(List=divide_curve_7.Points, Domain=construct_domain_5, Wrap=True)  # -> List, Index; disabled
panel_14 = Panel("""False
True""")  # disabled
panel_15 = Panel("""True
False""")  # disabled
panel_16 = Panel("""True
False""")  # disabled
cull_pattern = CullPattern(List=sub_list_6.List, CullPattern=panel_14)  # disabled
cull_pattern_2 = CullPattern(List=sub_list_7.List, CullPattern=panel_15)  # disabled
cull_pattern_3 = CullPattern(List=sub_list_8.List, CullPattern=panel_16)  # disabled
panel_17 = Panel("""1
0""")  # disabled
panel_18 = Panel("""1
0""")  # disabled
weave = Weave(Pattern=panel_18, Stream0=cull_pattern, Stream1=cull_pattern_2, NullGaps=False)  # disabled
weave_2 = Weave(Pattern=panel_17, Stream0=cull_pattern, Stream1=cull_pattern_3, NullGaps=False)  # disabled

# ---- group: Warren Spatial Truss / Final Geometries
polyline = PolyLine(Vertices=weave, Closed=False)  # disabled
polyline_2 = PolyLine(Vertices=weave_2, Closed=False)  # disabled
line_9 = Line(StartPoint=cull_pattern_2, EndPoint=cull_pattern_3)  # disabled

# ---- group: Warren Spatial Truss / Visualization
number_slider_6 = Slider(0.183, range=0..1)  # disabled
number_slider_7 = Slider(0.48, range=0..10)  # disabled
explode = Explode(Curve=polyline, Recursive=True)  # -> Segments, Vertices; disabled
explode_2 = Explode(Curve=polyline_2, Recursive=True)  # -> Segments, Vertices; disabled
pipe_3 = Pipe(Curve=[base_arch, top_left_arch, top_right_arch], Radius=number_slider_7, Caps=0)  # disabled
pipe_4 = Pipe(Curve=[explode_2.Segments, explode.Segments, line_9], Radius=number_slider_6, Caps=0)  # disabled
final_rendered_structure = Geometry([pipe_3, pipe_4])  # disabled
